# Grasshopper definition 0. Default.gh (Grasshopper 0.9.76)
# plug-ins: Python Interpreter
# Template to ensure all new recipes use the latest LB and HB modules.

honeybee = Honeybee_Honeybee()  # -> Vviiiiiiiiiizzz; plug-in component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
ladybug = Ladybug_Ladybug()  # -> Vviiiiiiiiiizzz; plug-in component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

# ----
# Use this recipe as the basis for all new recipes.
# 
# It will update HB and LB to the latest version.
# 
# Just set the toggle to "TRUE"
toggle = BooleanToggle(False)
updatehoneybee = Honeybee_UpdateHoneybee(updateAllUObjects=toggle)  # -> readMe; plug-in component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
updateladybug = Ladybug_UpdateLadybug(updateAllUObjects=toggle)  # -> readMe; plug-in component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
panel = Panel(updatehoneybee)
# Change result
# scale using sliders
# above
panel_2 = Panel(updateladybug)
