# Grasshopper definition BP_GEN_00_001_DEFAULT.gh (Grasshopper 0.9.76)
# plug-ins: Python Interpreter
# Default template to be used when creating new recipes from scratch. Updates installed HB and LB to latest versions.

honeybee = Honeybee_Honeybee()  # -> Vviiiiiiiiiizzz; plug-in component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
ladybug = Ladybug_Ladybug()  # -> Vviiiiiiiiiizzz; plug-in component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

# ----
# Use this recipe as the basis for all new recipes.
# 
# It will update HB and LB to the latest version.
# 
# Just set the toggle to "TRUE"
toggle = BooleanToggle(False)
updatehoneybee = Honeybee_UpdateHoneybee(updateAllUObjects=toggle)  # -> readMe; plug-in component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
updateladybug = Ladybug_UpdateLadybug(updateAllUObjects=toggle)  # -> readMe; plug-in component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
panel = Panel(updatehoneybee)
# Change result
# scale using sliders
# above
panel_2 = Panel(updateladybug)
