# Grasshopper definition BP_GEO_01_001_DWG_TO_DL.gh (Grasshopper 0.9.76)
# plug-ins: Python Interpreter, Human
# Converts 2D DWG drawings to a 3d model suitable for daylight simulations. Also creates Honeybee zones which can be exported as gbXML to IES.

honeybee = Honeybee_Honeybee()  # -> Vviiiiiiiiiizzz; plug-in component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
# Make sure model units are METERS
ladybug = Ladybug_Ladybug()  # -> Vviiiiiiiiiizzz; plug-in component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

# ----
# 3. Set window height and sill height
# 4. Set proportion of frame
frame_factor = Slider(0.1, range=0..0.3)
sill_height = Slider(0.8, range=0..1)
window_height = Slider(1.5, range=0.1..1.5)
Z = UnitZ(Factor=sill_height)
Z_2 = UnitZ(Factor=window_height)

# ----
# 1. Extrude Room internal surfaces from
# Room Outline curves
number_slider = Slider(3, range=0..10)
room_outline_curve = Curve([<curve referenced from the Rhino model> x73])
boundary = BoundarySurfaces(Edges=room_outline_curve)
Z_3 = UnitZ(Factor=number_slider)
extr = Extrude(Base=boundary, Direction=Z_3)

# ----
# 2. create window 'box' from window curve/line objects on plan
window_curves = Curve([<curve referenced from the Rhino model> x558])
join = JoinCurves(Curves=window_curves, Preserve=False)
boundary_2 = BoundarySurfaces(Edges=join)
join_2 = BrepJoin(Breps=boundary_2)  # -> Breps, Closed
bbox = BoundingBox(Content=join_2.Breps, Plane=PlaneXY(0, 0, 0))  # -> Box, Box_2
move = Move(Geometry=bbox.Box, Motion=Z)  # -> Geometry, Transform
extr_2 = Extrude(Base=move.Geometry, Direction=Z_2)
subtraction = Subtraction(A=1, B=frame_factor)
area = Area(Geometry=extr_2)  # -> Area, Centroid
scale = Scale(Geometry=extr_2, Center=area.Centroid, Factor=subtraction)  # -> Geometry, Transform
separatebynormal = Honeybee_SeparateByNormal(geometry=scale.Geometry)  # -> simplify(lookingUp), simplify(lookingDown), simplify(lookingSide); plug-in component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

# ----
# gets largest window box surface by area
area_2 = Area(Geometry=separatebynormal.lookingSide)  # -> Area, Centroid
sort = SortList(Keys=area_2.Area, ValuesA=separatebynormal.lookingSide)  # -> Keys, ValuesA
rev = ReverseList(List=sort.ValuesA)
split = SplitList(List=rev, Index=Slider(1, range=0..10))  # -> flatten(ListA), ListB

toggle = BooleanToggle(False)
updatehoneybee = Honeybee_UpdateHoneybee(updateAllUObjects=toggle)  # -> readMe; plug-in component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
updateladybug = Ladybug_UpdateLadybug(updateAllUObjects=toggle)  # -> readMe; plug-in component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
panel = Panel(updatehoneybee)
panel_2 = Panel(updateladybug)

# ----
# calculates the distance between the centre of
# the window and the nearest wall surface
area_3 = Area(Geometry=split.ListA)  # -> Area, Centroid
brep_cp = BrepClosestPoint(Point=graft(area_3.Centroid), Brep=extr)  # -> Point, Distance
sort_2 = SortList(Keys=brep_cp.Distance, ValuesA=brep_cp.Point)  # -> Keys, ValuesA
larger = LargerThan(FirstNumber=sort_2.Keys, SecondNumber=1)  # -> LargerThan, OrEqualTo
area_4 = Area(Geometry=split.ListA)  # -> Area, Centroid
sift = SiftPattern(List=sort_2.ValuesA, SiftPattern=larger.LargerThan)  # -> Output0, Output1
item = ListItem(List=sift.Output0, Index=0, Wrap=True)  # -> flatten(Item)

bldgprograms = Honeybee_bldgPrograms({"Office": 0, "Retail": 1, "MidriseApartment": 2, "PrimarySchool": 3, "SecondarySchool": 4, "SmallHotel": 5, "LargeHotel": 6, "Hospital": 7, "Outpatient": 8, "Warehouse": 9, "SuperMarket": 10, "FullServiceRestaurant": 11, "QuickServiceRestaurant": 12}, selected="PrimarySchool")
listzoneprograms = Honeybee_ListZonePrograms(bldgProgram=bldgprograms)  # -> PrimarySchoolZonePrograms; plug-in component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
list = ItemSelector(
    listzoneprograms,
    {"PrimarySchool::Mechanical", "PrimarySchool::Library", "PrimarySchool::Cafeteria", "PrimarySchool::Gym", "PrimarySchool::Restroom", "PrimarySchool::Office", "PrimarySchool::Classroom", "PrimarySchool::Kitchen", "PrimarySchool::Corridor", "PrimarySchool::Lobby"}, selected="PrimarySchool::Classroom")
toggle_2 = BooleanToggle(True)
mass2zone = Honeybee_Masses2Zones(zoneMasses=flatten(extr), zonePrograms=list, isConditioned=toggle_2, maxRoofAngle=30, createHBZones=toggle_2)  # -> readMe, HBZones; plug-in component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

# ----
# Extrudes windows in two directions and solve for intersection to
#  create outline of window on surface
vec2pt = Vector2Pt(PointA=area_4.Centroid, PointB=flatten(item), Unitize=False)  # -> Vector, Length
move_2 = Move(Geometry=split.ListA, Motion=vec2pt.Vector)  # -> Geometry, Transform
number_slider_2 = Slider(0.2, range=0..1)
facen = FaceNormals(Mesh=move_2.Geometry)  # -> Centers, flatten(Normals)
unit = UnitVector(Vector=facen.Normals)
rev_2 = Reverse(Vector=unit)
multiplication = Multiplication(A=unit, B=number_slider_2)
division = Division(A=number_slider_2, B=2)
extr_3 = Extrude(Base=move_2.Geometry, Direction=multiplication)
multiplication_2 = Multiplication(A=rev_2, B=division)
move_3 = Move(Geometry=extr_3, Motion=multiplication_2)  # -> Geometry, Transform
bbx = BrepBrep(BrepA=extr, BrepB=graft(move_3.Geometry))  # -> simplify(Curves), Points
boundary_3 = BoundarySurfaces(Edges=flatten(bbx.Curves))

zoneattributelist = Honeybee_ZoneAttributeList({"Name": "name", "Zone Program": "zoneProgram", "Zone Floor Area": "zoneFloorArea", "Zone Volume": "zoneVolume", "Building Program": "bldgProgram", "Is Conditioned": "isConditioned", "HVAC System Type": "HVACSystem", "Occupancy Schedule": "occupancySchedule", "Occupancy Activity Schedule": "occupancyActivitySch", "Heating SetPoint Schedule": "heatingSetPtSchedule"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}, selected="Zone Floor Area")
min_area_m2 = Slider(30, range=10..50)

ladybug_2 = Ladybug_Ladybug()  # -> Vviiiiiiiiiizzz; plug-in component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
honeybee_2 = Honeybee_Honeybee()  # -> Vviiiiiiiiiizzz; plug-in component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
toggle_3 = BooleanToggle(True)
updatehoneybee_2 = Honeybee_UpdateHoneybee(updateAllUObjects=toggle_3)  # -> readMe; plug-in component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
updateladybug_2 = Ladybug_UpdateLadybug(updateAllUObjects=toggle_3)  # -> readMe; plug-in component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
panel_3 = Panel(updatehoneybee_2)
panel_4 = Panel(updateladybug_2)

# ----
# 5. Set Analysis Plane wall offset distance
number_slider_3 = Slider(0.25, range=0..1)

# ----
# Preview surfaces
single_window_pane = Brep(boundary_3)

addhbglz = Honeybee_addHBGlz(
    HBObj=mass2zone.HBZones,
    childSurfaces=flatten(single_window_pane),
    EPConstructions="ASHRAE 90.1-2007 EXTWINDOW NONMETAL CLIMATEZONE 4")  # -> simplify(HBObjWGLZ); plug-in component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
labelzones = Honeybee_LabelZones(HBZones=flatten(addhbglz), attribute=zoneattributelist, textHeight=1)  # -> zoneTxtLabels, labelBasePts, brepTxtLabels, zoneWireFrames; plug-in component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
larger_2 = LargerThan(FirstNumber=labelzones.zoneTxtLabels, SecondNumber=min_area_m2)  # -> LargerThan, OrEqualTo
sift_2 = SiftPattern(List=flatten(addhbglz), SiftPattern=larger_2.OrEqualTo)  # -> Output0, Output1
clean = CleanTree(RemoveNulls=True, RemoveInvalid=True, RemoveEmpty=True, Tree=sift_2.Output1)
decomposebytype = Honeybee_DecomposeBasedOnType(HBZone=clean)  # -> walls, interiorWalls, airWalls, windows, interiorWindows, skylights, roofs, ceilings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; plug-in component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

ceiling = Brep(decomposebytype.roofs)
floor = Brep(decomposebytype.groundFloors)
walls = Brep(decomposebytype.walls)
preview = CustomPreview(Geometry=ceiling, Shader=ColourSwatch(SwatchColor=RGB(255, 251, 0)))
preview_2 = CustomPreview(Geometry=floor, Shader=ColourSwatch(SwatchColor=RGB(68, 255, 0)))
preview_3 = CustomPreview(Geometry=walls, Shader=ColourSwatch(SwatchColor=RGB(87, 87, 87)))
preview_4 = CustomPreview(Geometry=decomposebytype.windows, Shader=ColourSwatch(SwatchColor=RGBA(0, 242, 255, 91)))

debrep = DeconstructBrep(Brep=floor)  # -> Faces, flatten(Edges), Vertices
join_3 = JoinCurves(Curves=debrep.Edges, Preserve=False)
offset = Offset(Curve=join_3, Distance=number_slider_3, Plane=PlaneXY(0, 0, 0), Corners=1)  # -> flatten(Curve)
boundary_4 = BoundarySurfaces(Edges=offset)
flip = Flip(Surface=boundary_4)  # -> Surface, Result

number_slider_4 = Slider(0.8, range=0.3..0.8)
number_slider_5 = Slider(0.3, range=0.3..0.8)
number_slider_6 = Slider(0.8, range=0.3..0.8)
number_slider_7 = Slider(0.6, range=0.3..0.8)
radopaquematerial = Honeybee_RadianceOpaqueMaterial(
    materialName="Ceiling",
    RReflectance=number_slider_6,
    GReflectance=number_slider_6,
    BReflectance=number_slider_6,
    roughness=0.05,
    specularity=0)  # -> avrgRef, RADMaterial; plug-in component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
radopaquematerial_2 = Honeybee_RadianceOpaqueMaterial(
    materialName="Floor",
    RReflectance=number_slider_5,
    GReflectance=number_slider_5,
    BReflectance=number_slider_5,
    roughness=0.05,
    specularity=0)  # -> avrgRef, RADMaterial; plug-in component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
radopaquematerial_3 = Honeybee_RadianceOpaqueMaterial(
    materialName="Wall",
    RReflectance=number_slider_7,
    GReflectance=number_slider_7,
    BReflectance=number_slider_7,
    roughness=0.05,
    specularity=0)  # -> avrgRef, RADMaterial; plug-in component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
radglassmaterial = Honeybee_RadianceGlassMaterial(
    materialName="Window",
    RTransmittance=number_slider_4,
    GTransmittance=number_slider_4,
    BTransmittance=number_slider_4,
    refractiveIndex=1.52)  # -> avrgTrans, RADMaterial; plug-in component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
createhbsrfs = Honeybee_createHBSrfs(
    geometry=ceiling,
    srfName="Ceiling",
    srfType=3,
    EPBC="Outdoors",
    EPConstruction="ASHRAE 90.1-2004 EXTROOF IEAD CLIMATEZONE 1-4",
    RADMaterial=radopaquematerial.RADMaterial)  # -> readMe, simplify(HBSurface); plug-in component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
createhbsrfs_2 = Honeybee_createHBSrfs(
    geometry=floor,
    srfName="Floor",
    srfType=2,
    EPBC="Ground",
    EPConstruction="EXTSLAB 8IN CLIMATEZONE 1-8",
    RADMaterial=radopaquematerial_2.RADMaterial)  # -> readMe, simplify(HBSurface); plug-in component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
createhbsrfs_3 = Honeybee_createHBSrfs(
    geometry=walls,
    srfName="Wall",
    srfType=0,
    EPBC="Outdoors",
    EPConstruction="ASHRAE 189.1-2009 EXTWALL MASS CLIMATEZONE 4",
    RADMaterial=radopaquematerial_3.RADMaterial)  # -> readMe, simplify(HBSurface); plug-in component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
createhbsrfs_4 = Honeybee_createHBSrfs(
    geometry=decomposebytype.windows,
    srfName="Window",
    srfType=5,
    EPBC="Outdoors",
    EPConstruction="ASHRAE 90.1-2010 EXTWINDOW NONMETAL CLIMATEZONE 4",
    RADMaterial=radglassmaterial.RADMaterial)  # -> readMe, simplify(HBSurface); plug-in component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
