# Grasshopper definition BP_GEO_02_001_gbXML_TO_DL.gh (Grasshopper 0.9.76)
# plug-ins: Python Interpreter, Human
# Converts a gbXML file exported from IES to a thin walled rhino model. Built for IES, may work on other gbXMLs.

# ENSURE UNITS ARE SET TO METERS IN RHINO
honeybee = Honeybee_Honeybee()  # -> Vviiiiiiiiiizzz; plug-in component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
ladybug = Ladybug_Ladybug()  # -> Vviiiiiiiiiizzz; plug-in component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

# ----
# set gbXML location
gbxml_path = FilePath()
readgbxml = GbXMLReadGbXML(FilePath=gbxml_path)  # -> GbXML, GbXMLCampus
decompose_gbxmlcampus = GbXMLDecomposegbXMLCampus(GbXMLCampus=readgbxml.GbXMLCampus)  # -> Id, Heat, Cool, Name, Description, GbXMLLocation, GbXMLBuildings, GbXMLSurfaces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
decompose_gbxmlbuilding = GbXMLDecomposegbXMLBuilding(GbXMLBuilding=decompose_gbxmlcampus.GbXMLBuildings)  # -> Id, Type, Name, Description, Address, Area, AreaUnit, GbXMLStories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
decompose_gbxmlspace = GbXMLDecomposegbXMLSpace(GbXMLSpace=decompose_gbxmlbuilding.GbXMLSpaces)  # -> Id, Type, GbXMLZone, GbXMLSchedule, GbXMLLightSchedule, GbXMLEquipmentSchedule, GbXMLPeopleSchedule, Condition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
decompose_gbxmlsurface = GbXMLDecomposegbXMLSurface(GbXMLSurface=decompose_gbxmlcampus.GbXMLSurfaces)  # -> Id, Type, Name, Description, GbXMLConstruction, GbXMLScheduleShade, Exposed, GbXMLSpace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

toggle = BooleanToggle(False)
updatehoneybee = Honeybee_UpdateHoneybee(updateAllUObjects=toggle)  # -> readMe; plug-in component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
updateladybug = Ladybug_UpdateLadybug(updateAllUObjects=toggle)  # -> readMe; plug-in component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
panel = Panel(updateladybug)
panel_2 = Panel(updatehoneybee)

solid_surfaces = Brep(decompose_gbxmlsurface.GbXMLPlanarGeometry)

# ----
# Separate by Surface Name
panel_3 = Panel("Ceiling")
tmatch = MatchText(Text=decompose_gbxmlsurface.Type, Pattern=panel_3, Case=True)
tmatch_2 = MatchText(Text=decompose_gbxmlsurface.Type, Pattern="InteriorWall", Case=True)
tmatch_3 = MatchText(Text=decompose_gbxmlsurface.Type, Pattern="Roof", Case=True)
tmatch_4 = MatchText(Text=decompose_gbxmlsurface.Type, Pattern="SlabOnGrade", Case=True)
tmatch_5 = MatchText(Text=decompose_gbxmlsurface.Type, Pattern="ExteriorWall", Case=True)
tmatch_6 = MatchText(Text=decompose_gbxmlsurface.Type, Pattern="Shade", Case=True)
sift = SiftPattern(List=solid_surfaces, SiftPattern=tmatch)  # -> Output0, Output1
sift_2 = SiftPattern(List=solid_surfaces, SiftPattern=tmatch_2)  # -> Output0, Output1
sift_3 = SiftPattern(List=solid_surfaces, SiftPattern=tmatch_3)  # -> Output0, Output1
sift_4 = SiftPattern(List=solid_surfaces, SiftPattern=tmatch_4)  # -> Output0, Output1
sift_5 = SiftPattern(List=solid_surfaces, SiftPattern=tmatch_5)  # -> Output0, Output1
sift_6 = SiftPattern(List=solid_surfaces, SiftPattern=tmatch_6)  # -> Output0, Output1
clean = CleanTree(RemoveNulls=True, RemoveInvalid=True, RemoveEmpty=False, Tree=sift.Output1)
clean_2 = CleanTree(RemoveNulls=True, RemoveInvalid=True, RemoveEmpty=False, Tree=sift_2.Output1)
clean_3 = CleanTree(RemoveNulls=True, RemoveInvalid=True, RemoveEmpty=False, Tree=sift_3.Output1)
clean_4 = CleanTree(RemoveNulls=True, RemoveInvalid=True, RemoveEmpty=False, Tree=sift_4.Output1)
clean_5 = CleanTree(RemoveNulls=True, RemoveInvalid=True, RemoveEmpty=False, Tree=sift_5.Output1)
clean_6 = CleanTree(RemoveNulls=True, RemoveInvalid=True, RemoveEmpty=False, Tree=sift_6.Output1)

openings = Brep(flatten(decompose_gbxmlsurface.GbXMLOpenings))
separatebynormal = Honeybee_SeparateByNormal(geometry=openings)  # -> simplify(lookingUp), simplify(lookingDown), simplify(lookingSide); plug-in component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

# ----
# Generates a brep 0.001m thick (used as a tolerance) from vertical opening surfaces.
# Brep is used to create window in ceiling or roof.
deplane = DeconstructPlane(Plane=openings)  # -> Origin, XAxis, YAxis, ZAxis
pl = PlaneNormal(Origin=deplane.Origin, ZAxis=deplane.ZAxis)
amp = Amplitude(Vector=pl, Amplitude=0.001)
extr = Extrude(Base=openings, Direction=amp)
trim = TrimSolid(Shape=clean_3, Cutters=flatten(extr))  # -> simplify(Result)
item = ListItem(List=trim, Index=1, Wrap=True)  # -> flatten(Item)

# ----
# Generates a brep 0.001m thick (used as a tolerance) from vertical opening surfaces.
# Brep is used to create window in wall.
deplane_2 = DeconstructPlane(Plane=openings)  # -> Origin, XAxis, YAxis, ZAxis
pl_2 = PlaneNormal(Origin=deplane_2.Origin, ZAxis=deplane_2.ZAxis)
amp_2 = Amplitude(Vector=pl_2, Amplitude=0.001)
extr_2 = Extrude(Base=openings, Direction=amp_2)
trim_2 = TrimSolid(Shape=clean_5, Cutters=flatten(extr_2))  # -> simplify(Result)
item_2 = ListItem(List=trim_2, Index=1, Wrap=True)  # -> flatten(Item)

# ----
# Generates a brep 0.1m thick (used as a tolerance) from the external roof surface.
# Brep is used to check if window centre point is on roof.
number_slider = Slider(0.05, range=0..0.1)
deplane_3 = DeconstructPlane(Plane=clean_3)  # -> Origin, XAxis, YAxis, ZAxis
pl_3 = PlaneNormal(Origin=deplane_3.Origin, ZAxis=deplane_3.ZAxis)
amp_3 = Amplitude(Vector=pl_3, Amplitude=number_slider)
amp_4 = Amplitude(Vector=pl_3, Amplitude=number_slider)
rev = Reverse(Vector=amp_3)
extr_3 = Extrude(Base=clean_3, Direction=rev)
extr_4 = Extrude(Base=clean_3, Direction=amp_4)
join = BrepJoin(Breps=[extr_4, extr_3])  # -> Breps, Closed

# ----
# Generates a brep 0.1m thick (used as a tolerance) from the external wall surface.
# Brep is used to check if window centre point is on wall.
number_slider_2 = Slider(0.05, range=0..0.1)
deplane_4 = DeconstructPlane(Plane=clean_5)  # -> Origin, XAxis, YAxis, ZAxis
pl_4 = PlaneNormal(Origin=deplane_4.Origin, ZAxis=deplane_4.ZAxis)
amp_5 = Amplitude(Vector=pl_4, Amplitude=number_slider_2)
amp_6 = Amplitude(Vector=pl_4, Amplitude=number_slider_2)
rev_2 = Reverse(Vector=amp_5)
extr_5 = Extrude(Base=clean_5, Direction=rev_2)
extr_6 = Extrude(Base=clean_5, Direction=amp_6)
join_2 = BrepJoin(Breps=[extr_6, extr_5])  # -> Breps, Closed

area = Area(Geometry=flatten(separatebynormal.lookingUp))  # -> Area, Centroid
area_2 = Area(Geometry=flatten(separatebynormal.lookingSide))  # -> Area, Centroid
brepsinc = PointInBreps(Brep=join.Breps, Point=area.Centroid, Strict=False)  # -> Inside, Index
brepsinc_2 = PointInBreps(Brep=join_2.Breps, Point=area_2.Centroid, Strict=False)  # -> Inside, Index
trim_3 = TrimSolid(Shape=clean_2, Cutters=extr_2)
trim_4 = TrimSolid(Shape=clean, Cutters=extr)
sift_7 = SiftPattern(List=flatten(separatebynormal.lookingUp), SiftPattern=brepsinc.Inside)  # -> Output0, Output1
sift_8 = SiftPattern(List=flatten(separatebynormal.lookingSide), SiftPattern=brepsinc_2.Inside)  # -> Output0, Output1

# ----
# Horizontal
# Openings
colour_swatch = ColourSwatch(SwatchColor=RGB(28, 255, 3))
int_holes = Brep(sift_7.Output1)
colour_swatch_2 = ColourSwatch(SwatchColor=RGB(3, 255, 200))
rooflights = Brep(sift_7.Output0)
preview = CustomPreview(Geometry=rooflights, Shader=colour_swatch)
preview_2 = CustomPreview(Geometry=int_holes, Shader=colour_swatch_2)

# ----
# Vertical Openings
internal_openings = Brep(sift_8.Output0)
colour_swatch_3 = ColourSwatch(SwatchColor=RGB(167, 112, 255))
external_openings = Brep(sift_8.Output1)
colour_swatch_4 = ColourSwatch(SwatchColor=RGB(255, 107, 243))
preview_3 = CustomPreview(Geometry=internal_openings, Shader=colour_swatch_3)
preview_4 = CustomPreview(Geometry=external_openings, Shader=colour_swatch_4)

# ----
# Solid Surfaces
int_walls = Brep(trim_3)
colour_swatch_5 = ColourSwatch(SwatchColor=RGB(0, 51, 255))
ceilings = Brep(trim_4)
colour_swatch_6 = ColourSwatch(SwatchColor=RGB(255, 255, 255))
colour_swatch_7 = ColourSwatch(SwatchColor=RGB(0, 212, 255))
roof = Brep(item)
colour_swatch_8 = ColourSwatch(SwatchColor=RGB(138, 138, 138))
floors = Brep(simplify(clean_4))
colour_swatch_9 = ColourSwatch(SwatchColor=RGB(138, 0, 87))
ext_walls = Brep(item_2)
shade = Brep(clean_6)
colour_swatch_10 = ColourSwatch(SwatchColor=RGB(82, 0, 78))
preview_5 = CustomPreview(Geometry=ceilings, Shader=colour_swatch_6)
preview_6 = CustomPreview(Geometry=int_walls, Shader=colour_swatch_7)
preview_7 = CustomPreview(Geometry=roof, Shader=colour_swatch_8)
preview_8 = CustomPreview(Geometry=floors, Shader=colour_swatch_9)
preview_9 = CustomPreview(Geometry=ext_walls, Shader=colour_swatch_5)
preview_10 = CustomPreview(Geometry=shade, Shader=colour_swatch_10)

# ----
# BAKE?
panel_4 = Panel("Roof")
layers = CreateModifyLayers(LayerName="Ceilings", LayerColor=colour_swatch_6, DeleteLayer=False, enableFullPath=False)  # -> LayerNames, LayerFullPath
layers_2 = CreateModifyLayers(LayerName="Internal Walls", LayerColor=colour_swatch_7, DeleteLayer=False, enableFullPath=False)  # -> LayerNames, LayerFullPath
layers_3 = CreateModifyLayers(LayerName=panel_4, LayerColor=colour_swatch_8, DeleteLayer=False, enableFullPath=False)  # -> LayerNames, LayerFullPath
layers_4 = CreateModifyLayers(LayerName="Floor", LayerColor=colour_swatch_9, DeleteLayer=False, enableFullPath=False)  # -> LayerNames, LayerFullPath
layers_5 = CreateModifyLayers(LayerName="External Walls", LayerColor=colour_swatch_5, DeleteLayer=False, enableFullPath=False)  # -> LayerNames, LayerFullPath
layers_6 = CreateModifyLayers(LayerName="Rooflights", LayerColor=colour_swatch, DeleteLayer=False, enableFullPath=False)  # -> LayerNames, LayerFullPath
layers_7 = CreateModifyLayers(LayerName="Horizontal Internal Openings", LayerColor=colour_swatch_2, DeleteLayer=False, enableFullPath=False)  # -> LayerNames, LayerFullPath
layers_8 = CreateModifyLayers(LayerName="Vertical Internal Openings", LayerColor=colour_swatch_3, DeleteLayer=False, enableFullPath=False)  # -> LayerNames, LayerFullPath
layers_9 = CreateModifyLayers(LayerName="External Openings (Windows & Doors)", LayerColor=colour_swatch_4, DeleteLayer=False, enableFullPath=False)  # -> LayerNames, LayerFullPath
layers_10 = CreateModifyLayers(LayerName="Shade", LayerColor=colour_swatch_10, DeleteLayer=False, enableFullPath=False)  # -> LayerNames, LayerFullPath
createatts = CreateAttributes(LayerName=layers.LayerNames, enableFullPath=False)
createatts_2 = CreateAttributes(LayerName=layers_2.LayerNames, enableFullPath=False)
createatts_3 = CreateAttributes(LayerName=layers_3.LayerNames, enableFullPath=False)
createatts_4 = CreateAttributes(LayerName=layers_4.LayerNames, enableFullPath=False)
createatts_5 = CreateAttributes(LayerName=layers_5.LayerNames, enableFullPath=False)
createatts_6 = CreateAttributes(LayerName=layers_6.LayerNames, enableFullPath=False)
createatts_7 = CreateAttributes(LayerName=layers_7.LayerNames, enableFullPath=False)
createatts_8 = CreateAttributes(LayerName=layers_8.LayerNames, enableFullPath=False)
createatts_9 = CreateAttributes(LayerName=layers_9.LayerNames, enableFullPath=False)
createatts_10 = CreateAttributes(LayerName=layers_10.LayerNames, enableFullPath=False)
bake = BooleanToggle(False)
bake_2 = BakeGeometry(Bake=bake, Geometry=ceilings, Attributes=createatts)
bake_3 = BakeGeometry(Bake=bake, Geometry=int_walls, Attributes=createatts_2)
bake_4 = BakeGeometry(Bake=bake, Geometry=roof, Attributes=createatts_3)
bake_5 = BakeGeometry(Bake=bake, Geometry=floors, Attributes=createatts_4)
bake_6 = BakeGeometry(Bake=bake, Geometry=ext_walls, Attributes=createatts_5)
bake_7 = BakeGeometry(Bake=bake, Geometry=rooflights, Attributes=createatts_6)
bake_8 = BakeGeometry(Bake=bake, Geometry=int_holes, Attributes=createatts_7)
bake_9 = BakeGeometry(Bake=bake, Geometry=internal_openings, Attributes=createatts_8)
bake_10 = BakeGeometry(Bake=bake, Geometry=external_openings, Attributes=createatts_9)
bake_11 = BakeGeometry(Bake=bake, Geometry=shade, Attributes=createatts_10)
