# Grasshopper definition BP_PLN_03_001_SOL_RADIATION.gh (Grasshopper 0.9.76)
# plug-ins: Python Interpreter
# Basic solar radiation calculation with context

honeybee = Honeybee_Honeybee()  # -> Vviiiiiiiiiizzz; plug-in component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
ladybug = Ladybug_Ladybug()  # -> Vviiiiiiiiiizzz; plug-in component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

# ----
# 2. Assign surfaces of interest - has results grid
# and context (no results grid, blocks sun)
surfaces_of_interest = Brep([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])
context = Brep([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])

list = ValueList({"Hour of year": 0, "Analysis period": 1}, selected="Analysis period")
hour_of_year = Slider(4230, range=1..8760)

# ----
# 3. Select location using EPW file
# Choose diffuse and/or direct sun
# 4. Select Hour of Year
# or analysis period (disconnect HOY)
epw_file = FilePath("\\cjp.co.uk\London\Genesys\10_Software\IES\04_Downloads\Weather Downloads\CIBSE 2016\IES 2016 Data\London_LWC_DSY1.epw")
list_2 = ValueList({"145 sky patch (quick)": 0, "580 sky patch (slow)": 1}, selected="145 sky patch (quick)")
working_directory = Panel("L:\Rhino_projects\Usher\Sky")
generate_sky = BooleanToggle(True)
remove_diffuse = BooleanToggle(True)
remove_direct = BooleanToggle(False)
gencumulativeskymtx = Ladybug_GenCumulativeSkyMtx(epwFile=epw_file, skyDensity=list_2, workingDir=working_directory, useOldRes=True, runIt=generate_sky)  # -> readMe, cumulativeSkyMtx; plug-in component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
analysisperiod = Ladybug_AnalysisPeriod(
    fromMonth=Slider(1, range=1..12),
    fromDay=Slider(1, range=1..31),
    fromHour=Slider(1, range=1..24),
    toMonth=Slider(12, range=1..12),
    toDay=Slider(31, range=1..31),
    toHour=Slider(24, range=1..24))  # -> readMe, analysisPeriod; plug-in component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
switch = Switch(T=[hour_of_year, analysisperiod.analysisPeriod], i=list, G=list)  # -> _0, _1
selectskymtx = Ladybug_selectSkyMtx(
    cumulativeSkyMtx=gencumulativeskymtx.cumulativeSkyMtx,
    HOY=switch._0,
    analysisPeriod=switch._1,
    removeDiffuse=remove_diffuse,
    removeDirect=remove_direct)  # -> readMe, selectedSkyMtx; plug-in component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

# ---- group: North Sign
# 1. Set North
degrees = Slider(0, range=0..359)
sign_location = Point(Point(115.2521735, -13.27646148, 0))
scale = Slider(0.5, range=0.1..5)
northarrow = Ladybug_North(north=degrees, centerPt=sign_location, scale=scale)  # -> northSign; plug-in component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
geo = Geometry(northarrow)
preview = CustomPreview(Geometry=geo, Shader=ColourSwatch(SwatchColor=RGB(0, 0, 0)))

# ----
toggle = BooleanToggle(True)
updatehoneybee = Honeybee_UpdateHoneybee(updateAllUObjects=toggle)  # -> readMe; plug-in component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
updateladybug = Ladybug_UpdateLadybug(updateAllUObjects=toggle)  # -> readMe; plug-in component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
panel = Panel(updatehoneybee)
panel_2 = Panel(updateladybug)

# ----
# 5. Calculate and view results
# 6. Change Legend Settings
list_3 = ValueList({"Original Ladybug": 0, "Nuanced Ladybug": 1, "Multi-colored Ladybug": 2, "View Analysis 1": 3, "View Analysis 2 (Red,Green,Blue)": 4, "Sunlight Hours": 5, "Ecotect": 6, "Thermal Comfort Percentage": 7, "Thermal Comfort Colors": 8, "Thermal Comfort Colors (UTCI)": 9, "Hot Hours": 10, "Cold Hours": 11, "Shade Benefit/Harm": 12, "Thermal Comfort Colors v2 (UTCI)": 13, "Shade Harm": 14, "Shade Benefit": 15, "Black to White": 16, "CFD Colors 1": 17, "CFD Colors 2": 18, "Energy Balance": 19, "THERM": 20, "Cloud Cover": 21, "Glare Potential": 22, "Radiation Benefit": 23}, selected="Ecotect")
grid_size = Slider(1, range=1..5)
legend_min_value = Slider(0, range=0..100)
legend_max_value = Slider(500, range=0..1000)
run_simulation = BooleanToggle(True)
gradientlibrary = Ladybug_GradientLibrary(gradIndex=list_3)  # -> customColors; plug-in component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
legendpar = Ladybug_LegendParameters(lowBound=legend_min_value, highBound=legend_max_value, customColors=flatten(gradientlibrary))  # -> legendPar; plug-in component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
radiationanalysis = Ladybug_RadiationAnalysis(
    north=degrees,
    geometry=flatten(surfaces_of_interest),
    context=flatten(context),
    gridSize=grid_size,
    disFromBase=0.1,
    selectedSkyMtx=flatten(selectskymtx.selectedSkyMtx),
    legendPar=flatten(legendpar),
    parallel=True,
    runIt=run_simulation,
    workingDir=working_directory)  # -> readMe, contextMesh, analysisMesh, testPts, testVec, port, radiationResult, radiationMesh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; plug-in component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
context_preview = Geometry(radiationanalysis.contextMesh)
preview_2 = CustomPreview(Geometry=context_preview, Shader=ColourSwatch(SwatchColor=RGB(145, 145, 145)))

# ==== cluster Switch
T = ClusterInput()
i = ClusterInput()
G = ClusterInput()
tbi = TreeBranchIndex(DataTree=simplify(T), BranchIndex=i)
gate = StreamGate(Stream=tbi, Gate=G)  # -> Target0, Target1
_0 = ClusterOutput(gate.Target0)
_1 = ClusterOutput(gate.Target1)
